# Grasshopper definition script.gh (Grasshopper 1.0.8)

neg = Negative(Value=Slider(0.05757, range=0..0.2))
geo = Geometry(<curve referenced from the Rhino model>)
Z = UnitZ(Factor=neg)

number_slider = Slider(0.1, range=0..1)  # disabled
geo_2 = Geometry(<curve referenced from the Rhino model>)  # disabled
fillet = FilletDistance(Curve=geo_2, Distance=Slider(0.25, range=0..1))  # disabled
extr = Extrude()  # disabled
neg_2 = Negative(Value=number_slider)  # disabled
offset = OffsetCurve(Curve=fillet, Distance=neg_2, Corners=1)  # disabled
outer = Geometry(fillet)  # disabled
inner = Geometry(offset)  # disabled
number_slider_2 = Slider(0.029, range=0..0.05)  # disabled
debrep = DeconstructBrep(Brep=inner)  # -> Faces, Edges, Vertices; disabled
number_slider_3 = Slider(12, range=0..24)  # disabled
divide = DivideCurve(Curve=inner, Count=number_slider_3, Kinks=False)  # -> Points, Tangents, Parameters; disabled
addition = Addition(A=divide.Parameters, B=number_slider_2)  # disabled
subtraction = Subtraction(A=divide.Parameters, B=number_slider_2)  # disabled
eval = EvaluateCurve(Curve=inner, Parameter=addition)  # -> Point, Tangent, Angle; disabled
eval_2 = EvaluateCurve(Curve=inner, Parameter=subtraction)  # -> Point, Tangent, Angle; disabled
merge = Merge(Data1=addition, Data2=subtraction)  # disabled
crv_cp = CurveClosestPoint(Point=eval.Point, Curve=outer)  # -> Point, Parameter, Distance; disabled
crv_cp_2 = CurveClosestPoint(Point=eval_2.Point, Curve=outer)  # -> Point, Parameter, Distance; disabled
merge_2 = Merge(Data1=crv_cp.Parameter, Data2=crv_cp_2.Parameter)  # disabled
shift = ShiftList(List=eval_2.Point, Shift=1, Wrap=True)  # disabled
shift_2 = ShiftList(List=crv_cp_2.Point, Shift=1, Wrap=True)  # disabled
merge_3 = Merge(
    Data1=simplify(graft(eval.Point)),
    Data2=simplify(graft(shift)),
    Data3=simplify(graft(crv_cp.Point)),
    Data4=simplify(graft(shift_2)))  # disabled
shatter = Shatter(Curve=outer, Parameters=merge_2)  # disabled
shatter_2 = Shatter(Curve=inner, Parameters=merge)  # disabled
item = ListItem(List=merge_3, Index=0, Wrap=True)  # -> Item, Item1, Item2, Item3; disabled
ln = Line(StartPoint=item.Item2, EndPoint=item.Item3)  # disabled
ln_2 = Line(StartPoint=item.Item, EndPoint=item.Item1)  # disabled
panel = Panel(".5")  # disabled
eval_3 = EvaluateCurve(Curve=reparameterize(ln_2), Parameter=panel)  # -> Point, Tangent, Angle; disabled
panel_2 = Panel(".5")  # disabled
eval_4 = EvaluateCurve(Curve=reparameterize(ln), Parameter=panel_2)  # -> Point, Tangent, Angle; disabled
crv_cp_3 = CurveClosestPoint(Point=eval_3.Point, Curve=shatter)  # -> Point, Parameter, Distance; disabled
sort = SortList(Keys=crv_cp_3.Distance, ValuesA=shatter)  # -> Keys, ValuesA; disabled
crv_cp_4 = CurveClosestPoint(Point=eval_4.Point, Curve=shatter_2)  # -> Point, Parameter, Distance; disabled
sort_2 = SortList(Keys=crv_cp_4.Distance, ValuesA=shatter_2)  # -> Keys, ValuesA; disabled
item_2 = ListItem(List=sort.ValuesA, Index=0, Wrap=True)  # disabled
item_3 = ListItem(List=sort_2.ValuesA, Index=0, Wrap=True)  # disabled
end = EndPoints(Curve=item_2)  # -> Start, End; disabled
end_2 = EndPoints(Curve=item_3)  # -> Start, End; disabled
flip = FlipCurve(Curve=item_3)  # -> Curve, Flag; disabled
ln_3 = Line(StartPoint=end.End, EndPoint=end_2.End)  # disabled
ln_4 = Line(StartPoint=end.Start, EndPoint=end_2.Start)  # disabled
merge_4 = Merge(Data1=item_2, Data2=ln_4, Data3=flip.Curve, Data4=ln_3)  # disabled
join = JoinCurves(Curves=merge_4, Preserve=False)  # disabled

explode = Explode(Curve=geo, Recursive=True)  # -> Segments, Vertices
lng = ListLength(List=explode.Segments)
fillet_2 = FilletDistance(Curve=geo, Distance=Slider(0.25, range=0..1))
extr_2 = Extrude(Base=fillet_2, Direction=Z)
cap = CapHoles(Brep=extr_2)
multiplication = Multiplication(A=lng, B="3")
number_slider_4 = Slider(24, range=0..128)
neg_3 = Negative(Value=Slider(0.1, range=0..1))
offset_2 = OffsetCurve(Curve=fillet_2, Distance=neg_3, Corners=1)
extr_3 = Extrude(Base=offset_2, Direction=Z)
cap_2 = CapHoles(Brep=extr_3)
geo_3 = Geometry(offset_2)
sdiff = SolidDifference(BrepsA=cap, BrepsB=cap_2)
offset_3 = OffsetCurve(Curve=fillet_2, Distance=neg_3, Corners=1)
multiplication_2 = Multiplication(A=number_slider_4, B="2")
pt = ConstructPoint(XCoordinate=0, YCoordinate=0, ZCoordinate=0)
Y = UnitY(Factor="10")
line = LineSDL(Start=pt, Direction=Y, Length="10")
divide_2 = DivideCurve(Curve=geo, Count=number_slider_4, Kinks=False)  # -> Points, Tangents, Parameters
outer_2 = Geometry(fillet_2)
division = Division(A=neg_3, B="2")
inner_2 = Geometry(offset_3)
offset_4 = OffsetCurve(Curve=fillet_2, Distance=division, Corners=1)
clx = CurveLine(Curve=offset_4, Line=line)  # -> Points, Params, Count
item_4 = ListItem(List=clx.Params, Index=0, Wrap=True)
shatter_3 = Shatter(Curve=offset_4, Parameters=item_4)
divide_3 = DivideCurve(Curve=shatter_3, Count=multiplication_2, Kinks=False)  # -> Points, Tangents, Parameters
crv_cp_5 = CurveClosestPoint(Point=divide_3.Points, Curve=fillet_2)  # -> Point, Parameter, Distance
crv_cp_6 = CurveClosestPoint(Point=divide_3.Points, Curve=geo_3)  # -> Point, Parameter, Distance
crv_cp_7 = CurveClosestPoint(Point=divide_2.Points, Curve=inner_2)  # -> Point, Parameter, Distance
crv_cp_8 = CurveClosestPoint(Point=divide_2.Points, Curve=outer_2)  # -> Point, Parameter, Distance
offset_5 = OffsetCurve(Curve=offset_4, Distance=neg_3, Corners=1)
crv_cp_9 = CurveClosestPoint(Point=divide_3.Points, Curve=graft(offset_5))  # -> simplify(Point), Parameter, simplify(Distance)
path_mapper = PathMapper(crv_cp_9.Point, source=["{A}(i)", "(i)"], target=["{i}(A)", "{i}"])
path_mapper_2 = PathMapper(crv_cp_9.Distance, source=["{A}(i)", "(i)"], target=["{i}(A)", "{i}"])
shatter_4 = Shatter(Curve=shatter_3, Parameters=divide_3.Parameters)
ln_5 = Line(StartPoint=crv_cp_6.Point, EndPoint=crv_cp_5.Point)
len = Length(Curve=shatter_4)
curvature = Curvature(Curve=outer_2, Parameter=crv_cp_8.Parameter)  # -> P, K, C
curvature_2 = Curvature(Curve=inner_2, Parameter=crv_cp_8.Parameter)  # -> P, K, C
Z_2 = UnitZ(Factor=Slider(-0.133, range=-1..0))
extr_4 = Extrude(Base=offset_4, Direction=Z_2)
sort_3 = SortList(Keys=path_mapper_2, ValuesA=path_mapper)  # -> Keys, ValuesA
item_5 = ListItem(List=sort_3.ValuesA, Index=0, Wrap=True)
extr_5 = Extrude(Base=offset_5, Direction=Z_2)
vlen = VectorLength(Vector=curvature_2.K)
vlen_2 = VectorLength(Vector=curvature.K)
flatten = FlattenTree(Tree=item_5, Path="{0}")
ln_6 = Line(StartPoint=divide_3.Points, EndPoint=flatten)
cap_3 = CapHoles(Brep=extr_4)
extr_6 = Extrude(Base=ln_6, Direction=Z_2)
equals = Equality(FirstNumber=vlen_2, SecondNumber="0")  # -> Equality, Inequality
equals_2 = Equality(FirstNumber=vlen, SecondNumber="0")  # -> Equality, Inequality
cap_4 = CapHoles(Brep=extr_5)
sdiff_2 = SolidDifference(BrepsA=cap_3, BrepsB=cap_4)
cull = CullPattern(List=crv_cp_8.Parameter, CullPattern=equals.Equality)
cull_2 = CullPattern(List=crv_cp_7.Parameter, CullPattern=equals_2.Equality)
move = Move(Geometry=sdiff_2, Motion=Z_2)  # -> Geometry, Transform
evalsrf = EvaluateSurface(Surface=extr_6, Point=".5,.5")  # -> Point, Normal, UDirection, VDirection, Frame
multiplication_3 = Multiplication(A=Z_2, B="2")
number_slider_5 = Slider(0.0468035, range=0..0.2)
subtraction_2 = Subtraction(A=cull_2, B=number_slider_5)
addition_2 = Addition(A=cull_2, B=number_slider_5)
subtraction_3 = Subtraction(A=cull, B=number_slider_5)
addition_3 = Addition(A=cull, B=number_slider_5)
move_2 = Move(Geometry=sdiff, Motion=multiplication_3)  # -> Geometry, Transform
move_3 = Move(Geometry=ln_5, Motion=multiplication_3)  # -> Geometry, Transform
merge_5 = Merge(Data1=graft(addition_2), Data2=graft(subtraction_2))
merge_6 = Merge(Data1=graft(addition_3), Data2=graft(subtraction_3))
extr_7 = Extrude(Base=move_3.Geometry, Direction=Z)
eval_5 = EvaluateCurve(Curve=inner_2, Parameter=merge_5)  # -> simplify(Point), Tangent, Angle
eval_6 = EvaluateCurve(Curve=outer_2, Parameter=merge_6)  # -> simplify(Point), Tangent, Angle
bbx = BrepBrep(BrepA=sdiff_2, BrepB=extr_6)  # -> Curves, Points
rev = ReverseList(List=eval_5.Point)  # -> flatten(List)
rev_2 = ReverseList(List=eval_6.Point)  # -> flatten(List)
shatter_5 = Shatter(Curve=inner_2, Parameters=flatten(merge_5))
outer_3 = Geometry(outer_2)
shatter_6 = Shatter(Curve=outer_3, Parameters=flatten(merge_6))
move_4 = Move(Geometry=bbx.Curves, Motion=Z_2)  # -> Geometry, Transform
py3 = Python3Script(x=rev_2)  # -> a1, a2, a3, a4; inputs x: list
# ---------- py3: Python ----------
col=[[]for _ in range(4)]
for i in range(len(x)):
    col_i = i%4
    col[col_i].append(x[i])
    



a1,a2,a3,a4=col
# ---------- end py3 ----------
py3_2 = Python3Script(x=rev)  # -> a1, a2, a3, a4; inputs x: list; same code as py3
shift_3 = ShiftList(List=py3.a4, Shift=Slider(-1, range=-1..1), Wrap=True)
geo_4 = Geometry(simplify(graft(py3.a1)))
geo_5 = Geometry(simplify(graft(py3.a2)))
geo_6 = Geometry(simplify(graft(py3_2.a1)))
geo_7 = Geometry(simplify(graft(py3_2.a2)))
geo_8 = Geometry(simplify(graft(py3_2.a3)))
geo_9 = Geometry(simplify(graft(py3.a3)))
geo_10 = Geometry(simplify(graft(shift_3)))
shift_4 = ShiftList(List=py3_2.a4, Shift=Slider(-1, range=-1..1), Wrap=True)
geo_11 = Geometry(simplify(graft(shift_4)))
merge_7 = Merge(Data1=geo_4, Data2=geo_6, Data3=geo_11, Data4=geo_10, Data5=geo_4)
merge_8 = Merge(Data1=geo_5, Data2=geo_7, Data3=geo_8, Data4=geo_9, Data5=geo_5)
pline = PolyLine(Vertices=merge_8, Closed=False)
pline_2 = PolyLine(Vertices=merge_7, Closed=False)
weave = Weave(Pattern=[0, 1], Stream0=flatten(pline_2), Stream1=flatten(pline), NullGaps=False)
weave_2 = Weave(Pattern=[0, 1], Stream0=flatten(pline_2), Stream1=flatten(pline), NullGaps=False)
explode_2 = Explode(Curve=weave, Recursive=True)  # -> Segments, Vertices
explode_3 = Explode(Curve=weave_2, Recursive=True)  # -> Segments, Vertices
item_6 = ListItem(List=explode_2.Segments, Index=Slider(3, range=0..3), Wrap=True)
item_7 = ListItem(List=explode_2.Segments, Index=Slider(0, range=0..3), Wrap=True)
item_8 = ListItem(List=explode_3.Segments, Index=Slider(1, range=0..3), Wrap=True)
item_9 = ListItem(List=explode_3.Segments, Index=Slider(2, range=0..3), Wrap=True)
geo_12 = Geometry(flatten(shatter_5))
eval_7 = EvaluateCurve(Curve=reparameterize(item_6), Parameter=".5")  # -> flatten(Point), Tangent, Angle
eval_8 = EvaluateCurve(Curve=reparameterize(item_8), Parameter=".5")  # -> flatten(Point), Tangent, Angle
geo_13 = Geometry(flatten(shatter_6))
graft = GraftTree(Tree=geo_13, IncludeEmptyLists=True, IncludeNullItems=True)
graft_2 = GraftTree(Tree=geo_12, IncludeEmptyLists=True, IncludeNullItems=True)
crv_cp_10 = CurveClosestPoint(Point=eval_7.Point, Curve=graft)  # -> Point, Parameter, simplify(Distance)
py3_3 = Python3Script(x=crv_cp_10.Distance)  # -> a; inputs x: tree
# ---------- py3_3: Python ----------
from ghpythonlib import treehelpers as th
import numpy as np

x = th.tree_to_list(x,retrieve_base=lambda x: x)

x = np.array(x)
a = np.argmin(x.T,axis=1).tolist()
# ---------- end py3_3 ----------
crv_cp_11 = CurveClosestPoint(Point=eval_8.Point, Curve=graft_2)  # -> Point, Parameter, simplify(Distance)
py3_4 = Python3Script(x=crv_cp_11.Distance)  # -> a; inputs x: tree; same code as py3_3
item_10 = ListItem(List=geo_13, Index=py3_3, Wrap=True)
item_11 = CherryPicker(item_10, ListIndex=0)
end_3 = EndPoints(Curve=item_11)  # -> Start, End
item_12 = ListItem(List=geo_12, Index=py3_4, Wrap=True)
geo_14 = Geometry(end_3.Start)
flip_2 = FlipCurve(Curve=item_12)  # -> Curve, Flag
merge_9 = Merge(Data1=simplify(item_7), Data2=simplify(graft(flip_2.Curve)), Data3=simplify(item_9), Data4=simplify(graft(item_10)))
join_2 = JoinCurves(Curves=merge_9, Preserve=False)  # -> flatten(Curves)
Z_3 = UnitZ(Factor=Slider(0.0881, range=0..0.5))
extr_8 = Extrude(Base=join_2, Direction=Z_3)
cap_5 = CapHoles(Brep=extr_8)
geo_15 = Geometry([cap_4, sdiff_2, cap_5, bbx.Curves, move.Geometry, move_4.Geometry, move_2.Geometry, extr_7])
preview = CustomPreview(
    Geometry=geo_15,
    Material={diffuse=RGB(228, 178, 227), emission=RGB(68, 53, 68), shine=0.5, specular=RGB(255, 254, 255), transparency=0})
